# Dynamo graph CreateSpatialStructure.dyn (Dynamo 2.8.0.2471)

createIfcModel = IfcInfraToolKit_DynamoCore.IfcModelSetup.CreateIfcModel()
code_block = CodeBlock { "testFacility"; }
code_block_2 = CodeBlock { "nul"; }
addFacility = IfcInfraToolKit_DynamoCore.IfcModelSetup.AddFacility(databaseContainer=createIfcModel, facilityName=code_block, hostGuid=code_block_2)
directory_path = Directory("C:\Users\Sebastian Esser\Desktop")
code_block_3 = CodeBlock { "blub"; }
saveIfcModel = IfcInfraToolKit_DynamoCore.IfcModelSetup.SaveIfcModel(container=addFacility.DatabaseContainer, path=directory_path, modelName=code_block_3)
watch = Watch(addFacility.FacilityGUID)
