# Dynamo graph CreateSpatialStructure_FacilityPartPDT.dyn (Dynamo 2.10.0.3455)

# group: PredefinedType of IfcFacilityPart
getAvailableFacilityPartTypes = IfcInfraToolKit_DynamoCore.SpatialStructureDesigner.GetAvailableFacilityPartTypes()
watch = Watch(getAvailableFacilityPartTypes)
code_block = CodeBlock(list=watch) { list[2]; }
getPredefinedType = IfcInfraToolKit_DynamoCore.SpatialStructureDesigner.GetPredefinedType(FacilityPartEnum=code_block)
code_block_2 = CodeBlock(list=getPredefinedType) { list[4]; }

# group: IFC content
createIfcModel = IfcInfraToolKit_DynamoCore.IfcModelSetup.CreateIfcModel()
addFacility = IfcInfraToolKit_DynamoCore.SpatialStructureDesigner.AddFacility(databaseContainer=createIfcModel)
code_block_3 = CodeBlock { "TestFacilityPart"; }
addFacilityPart = IfcInfraToolKit_DynamoCore.SpatialStructureDesigner.AddFacilityPart(databaseContainer=addFacility.DatabaseContainer, name=code_block_3, facilityType=code_block_2, selectType=code_block, hostGuid=addFacility.FacilityGUID)

# group: Check IFC content
getSpatialStructureItems = IfcInfraToolKit_DynamoCore.IfcModelSetup.GetSpatialStructureItems(databaseContainer=addFacilityPart.DatabaseContainer)
watch_2 = Watch(getSpatialStructureItems.PredefinedTypes)
