# Dynamo graph PTworkflow.dyn (Dynamo 2.8.0.2471)

file_path = Filename(".\pier_1.off")
loadOffGeometry = IfcInfraToolKit_DynamoCore.MeshImporter.LoadOffGeometry(offFilePath=file_path)
visualize = IfcInfraToolKit_DynamoCore.MeshImporter.Visualize(geometry=loadOffGeometry)
